# Dynamo graph FILIN_РасчетИнсоляции_АдаптивноеСемействоОкна_3dлучи.dyn (Dynamo 2.6.1.8786)
# packages: Data-Shapes 2021.2.94

# note: Script Name: FILIN_РасчетИнсоляции_АдаптивноеСемействоОкна_3dлучи.dyn
# Packages used in this script:
# List Contains version: 0.1.0
# remove duplicates version: 0.0.1
# Type Name version: 0.1.0
# Data-Shapes version: 2021.2.94
# TimeStamp : 2026/3/3 17:23
# note: Script Name: FILIN_РасчетИнсоляции_АдаптивноеСемействоОкна_3dлучи.dyn
# Packages used in this script:
# List Contains version: 0.1.0
# remove duplicates version: 0.0.1
# Type Name version: 0.1.0
# Data-Shapes version: 2021.2.94
# TimeStamp : 2026/3/3 17:30

# group: Get Center
выбрать_окно = DSModelElementSelection()  # 1 picked in the model; graph input
element_to_instance = Python(IN[0]=выбрать_окно)
# ---------- element_to_instance.python (29 lines) ----------
# -*- coding: utf-8 -*-

import clr

# Revit API
clr.AddReference('RevitAPI')
clr.AddReference('RevitServices')
from Autodesk.Revit.DB import *
from RevitServices.Persistence import DocumentManager
from RevitServices.Transactions import TransactionManager

doc = DocumentManager.Instance.CurrentDBDocument

# IN[0] – Element(s) from Dynamo (can be from "Select Model Elements" or "Select Model Element")
elements = UnwrapElement(IN[0])

if not isinstance(elements, list):
    elements = [elements]

family_instances = []

for el in elements:
    if isinstance(el, FamilyInstance):
        family_instances.append(el)
    else:
        family_instances.append(None)  # Not a family instance

# Output
OUT = family_instances
# ----------------------------------------
getChildElements = Element.GetChildElements(element=выбрать_окно)
string_from_object = FromObject(obj=getChildElements)
string = StringInput("ЦентрИнсоляции_Тех")
code_block = CodeBlock(a=string_from_object, b=string) { a==b; }
filterByBoolMask = List.FilterByBoolMask(list=getChildElements, mask=code_block)
getLocation = Element.GetLocation(element=filterByBoolMask.in)
code_block_2 = CodeBlock { 0; }
getItemAtIndex = List.GetItemAtIndex(list=getLocation, index=code_block_2)
id = Element.Id(element=выбрать_окно)

# group: True North Vector
Z = CodeBlock { 0; }
x = CodeBlock { 0; }
Y = CodeBlock { 1; }
byCoordinates = Vector.ByCoordinates(x=x, y=Y, z=Z)
ZAxis = Vector.ZAxis()
projectRotation = Coordinates.ProjectRotation()
rotate = Vector.Rotate(vector=byCoordinates, axis=ZAxis, degrees=projectRotation)

# group: ProjectNorth VECTOR Z = 0 X--NORTH Y--WEST/EAST
surveyPoint = Coordinates.SurveyPoint()  # frozen
X = Point.X(point=surveyPoint)
Y_2 = Point.Y(point=surveyPoint)
byCoordinates_2 = Point.ByCoordinates(x=X, y=Y_2, z=Z)

# group: True North Vector visualise
number_slider = DoubleSlider(1000, range=5..10000 step 1)  # frozen
code_block_3 = CodeBlock(a=number_slider) { a*1000; }
byStartPointDirectionLength = Line.ByStartPointDirectionLength(startPoint=byCoordinates_2, direction=rotate, length=code_block_3)

# group: ProjectNorth VECTOR visualise
number_slider_2 = DoubleSlider(50, range=5..10000 step 1)  # frozen
code_block_4 = CodeBlock(a=number_slider_2) { a*1000; }
byStartPointDirectionLength_2 = Line.ByStartPointDirectionLength(startPoint=byCoordinates_2, direction=byCoordinates, length=code_block_4)

# group: ClockWork Rotation From TrueNorth to ProjectNorth
angleWithVector = Vector.AngleWithVector(vector=byCoordinates, otherVector=rotate)  # frozen

# group: Set Start and End time
год = DoubleSlider(2020, range=2020..5000 step 1)  # graph input
месяц = DoubleSlider(4, range=1..12 step 1)  # graph input
день = DoubleSlider(22, range=1..31 step 1)  # graph input
начало_расчета_час = DoubleSlider(6, range=0..24 step 1)  # graph input
начало_расчета_минута = DoubleSlider(0, range=0..60 step 1)  # graph input
конец_расчета_час = DoubleSlider(18, range=0..24 step 1)  # graph input
конец_расчета_минута = DoubleSlider(0, range=0..60 step 1)  # graph input

# group: Set Timezone
часовой_пояс_utc = DoubleSlider(3, range=-60..60 step 1)  # graph input

# group: Set calculation time period
расчетный_шаг_минута = DoubleSlider(20, range=0..60 step 1)  # graph input

# group: Set +-: North + South - East + West-
широта_n_северная_s_южная = StringInput("n")  # graph input
долгота_w_восточная_e_западная = StringInput("w")  # graph input

calculateSunPosition = Custom[CalculateSunPosition](Year=год, Month=месяц, Day=день, Start_Hour=начало_расчета_час, Start_Minute=начало_расчета_минута, End_Hour=конец_расчета_час, End_Minute=конец_расчета_минута, UTC=часовой_пояс_utc, TimeStep=расчетный_шаг_минута, North_South=широта_n_северная_s_южная, East_West=долгота_w_восточная_e_западная)  # Calculates sun posion for time perod on chosen date. Uses NOAA SPA method with error ≈ 1°. North_South: use "n-north, s-south" East_West: use"w-west, e-east"

# group: Altitude rotation
XAxis = Vector.XAxis()
rotate_2 = Vector.Rotate(vector=rotate, axis=XAxis, degrees=calculateSunPosition.Altitudes)

code_block_5 = CodeBlock(a=calculateSunPosition.Azimuts) { -a; }

# group: Azimuth rotation
ZAxis_2 = Vector.ZAxis()
rotate_3 = Vector.Rotate(vector=rotate_2, axis=ZAxis_2, degrees=code_block_5)

# group: Get Ray Bounce, drop rays that bounce.
n3d_вид_для_анализа = Views("АНАЛИЗ_Исноляция_3D")  # "3D вид для анализа"; graph input
boolean = BoolSelector(false)
raybounce_on_linked_model = Custom[RayBounce On Linked Model](Points=getItemAtIndex, Direction=rotate_3, ThreeDView=n3d_вид_для_анализа, BounceOnLinkOnly=boolean)  # package Data-Shapes; Same functionality as raybounce but takes linked model elements into account
isNull = Object.IsNull(obj=raybounce_on_linked_model.Elements)
flatten = List.Flatten(list=isNull)

# group: Get rays VECTOR
filterByBoolMask_2 = List.FilterByBoolMask(list=rotate_3, mask=flatten)
flatten_2 = List.Flatten(list=filterByBoolMask_2.in)

# group: Get rays TIME
filterByBoolMask_3 = List.FilterByBoolMask(list=calculateSunPosition.Time, mask=flatten)

# group: Recognize PERIODS of time list
string_from_object_2 = FromObject(obj=filterByBoolMask_3.in)
string_2 = StringInput(" ")
split = String.Split(str=string_from_object_2, separator0=string_2)
lastItem = List.LastItem(list=split@L2)
python_script = Python(IN[0]=lastItem, IN[1]=расчетный_шаг_минута)
# ---------- python_script.python (54 lines) ----------
from datetime import datetime, timedelta

# Входы из Dynamo
times_str = IN[0]          # список строк формата "HH:MM:SS"
step_minutes = IN[1]        # шаг в минутах (число)

# Конвертируем строки в datetime
times = [datetime.strptime(t, "%H:%M:%S") for t in times_str]

# Удаляем подряд идущие дубликаты времени
def remove_consecutive_duplicates(dt_list):
    if not dt_list:
        return dt_list
    out = [dt_list[0]]
    for t in dt_list[1:]:
        if t != out[-1]:
            out.append(t)
    return out

times = remove_consecutive_duplicates(times)

periods = []
if times:
    start_time = times[0]
    prev_time = times[0]
    start_idx = 0  # индекс начала периода

    for idx, current in enumerate(times[1:], start=1):
        delta = current - prev_time

        # Игнорируем дубликаты (хоть и они уже удалены, на всякий случай)
        if delta == timedelta(0):
            continue

        if delta == timedelta(minutes=step_minutes):
            prev_time = current
        else:
            # Только если период действительно длился
            if prev_time != start_time:
                ray_indxs = list(range(start_idx, idx))
                duration = int((prev_time - start_time).total_seconds() / 60) + step_minutes
                periods.append((start_time.time(), prev_time.time(), duration, ray_indxs))
            start_time = current
            prev_time = current
            start_idx = idx

    # последний период
    ray_indxs = list(range(start_idx, len(times)))
    if prev_time != start_time:
        duration = int((prev_time - start_time).total_seconds() / 60) + step_minutes
        periods.append((start_time.time(), prev_time.time(), duration, ray_indxs))

# Вывод
OUT = periods
# ----------------------------------------
lastItem_2 = List.LastItem(list=python_script@L3)
getItemAtIndex_2 = List.GetItemAtIndex(list=flatten_2, index=lastItem_2)

# group: SUN RAY vector visualise for Segment Family on plan view
длина_визуализации_сегмента_на = DoubleSlider(100, range=2..10000 step 1)  # "Длина визуализации сегмента на Плане (м)"
code_block_6 = CodeBlock(a=длина_визуализации_сегмента_на) { a*1000; }
byStartPointDirectionLength_3 = Line.ByStartPointDirectionLength(startPoint=getItemAtIndex, direction=getItemAtIndex_2, length=code_block_6)

first_and_last_vectors_with = Python(IN[0]=byStartPointDirectionLength_3)  # "First and last vectors with ierarchie"
# ---------- first_and_last_vectors_with.python (9 lines) ----------
# IN[0] — ваш список из кортежей/списков
data = IN[0]

# для каждого элемента берем первый и последний элементы
OUT = [ (t[0], t[-1]) if isinstance(t, (list, tuple)) and len(t) >= 2 else None for t in data ]

# Пример:
# input  -> [(a, b), (a, b, c, d), (a, b, c)]
# output -> [(a, b), (a, d), (a, c)]
# ----------------------------------------

# group: Create 3d DirectShape for ray segments
endPoint = Curve.EndPoint(curve=first_and_last_vectors_with)
addItemToFront = List.AddItemToFront(item=getItemAtIndex, list=endPoint@L2)
code_block_7 = CodeBlock { 0; }
code_block_8 = CodeBlock { 1; }
code_block_9 = CodeBlock { 2; }
byIndices = IndexGroup.ByIndices(a=code_block_7, b=code_block_8, c=code_block_9)
byPointsFaceIndices = Mesh.ByPointsFaceIndices(vertexPositions=addItemToFront@L2, indices=byIndices)
categories = Categories("OST_Mass")
count = List.Count(list=first_and_last_vectors_with)
code_block_10 = CodeBlock(a=count) { (1..a); }
code_block_11 = CodeBlock(a=id, b=code_block_10) { "RayForm_"+a+"_"+b; }
byMesh = DirectShape.ByMesh(mesh=byPointsFaceIndices, category=categories, name=code_block_11)
